% Simulink data dictionary CAT_797F.sldd

Payload = Simulink.Parameter(0, DataType="fixdt(1,10,0)", Unit="tonne")  % Payload machine mass
Iz = Simulink.Parameter(7190000)  % Inertia in the z-axis
Cf = Simulink.Parameter(5047000)  % Front Cornering Stiffness Coeficient (From front tire)
Cr = Simulink.Parameter(5047000)  % Rear Cornering Stiffness Coeficient (From rear tire)
sim_t = Simulink.Parameter(30)  % Simulation_time
Lf = Simulink.Parameter(4.8, Unit="m")  % Distance from the CG to the front axle
Lr = Simulink.Parameter(2.4, Unit="m")  % Distance from the CG to the rear axle
Machine_Mass = Simulink.Parameter(623690, DataType="fixdt(1,26,0)", Unit="tonne")  % Machine mass
C1 = Simulink.Parameter(170)
Kd = Simulink.Parameter(0.75)
C2 = Simulink.Parameter(200)