% Simulink data dictionary CAT_797F.sldd

Payload = Simulink.Parameter(0, DataType="fixdt(1,10,0)", Unit="tonne")  % Payload machine mass
Lf = Simulink.Parameter(2.5, Unit="m")  % Distance from the CG to the front axle
Lr = Simulink.Parameter(2.3, Unit="m")  % Distance from the CG to the rear axle
Iz = Simulink.Parameter(7190000)  % Inertia in the z-axis
Cf = Simulink.Parameter(5047000)  % Front Cornering Stiffness Coeficient (From front tire)
Cr = Simulink.Parameter(5047000)  % Rear Cornering Stiffness Coeficient (From rear tire)
sim_t = Simulink.Parameter(30)  % Simulation_time
k0 = Simulink.Parameter(3)
k1 = Simulink.Parameter(3.8)
ki = Simulink.Parameter(0.2)
ky = Simulink.Parameter(1.5)
Machine_Mass = Simulink.Parameter(280, DataType="fixdt(1,10,0)", Unit="tonne")  % Machine mass
C1 = Simulink.Parameter(200)
C2 = Simulink.Parameter(160)
Kd = Simulink.Parameter(18025)