% Simulink data dictionary CAT_797F.sldd

Cf = Simulink.Parameter(0.5)  % Front Cornering Stiffness Coeficient (From front tire)
Cr = Simulink.Parameter(0.5)  % Rear Cornering Stiffness Coeficient (From rear tire)
Machine_Mass = Simulink.Parameter(280, DataType="fixdt(1,10,0)", Unit="tonne")  % Machine mass
Payload = Simulink.Parameter(0, DataType="fixdt(1,10,0)", Unit="tonne")  % Payload machine mass
Lf = Simulink.Parameter(2.5, Unit="m")  % Distance from the CG to the front axle
Lr = Simulink.Parameter(2.3, Unit="m")  % Distance from the CG to the rear axle